vi "Main_transmitter.gvi"   [LabVIEW Communications System Design Suite 2.0.1]
panel controls:
  "Device ID": "niUSRPClass"
  "IQ rate": f64
  "Carrier Frequency": f64
  "Gain": f64
  "Enabled Channel": string = "0"
  "Active Antenna": i32 = "TX1"(0)
  "Active Antenna_2": i32 = "TX1"(0)
  "Stop": bool
diagram:
  w1 = $"Enabled Channel"
  Array Index(array=["TX1", "TX2"]) -> (out0[$"Active Antenna"]=w2)
  call "niUSRP Open Tx Session.gvi"(device names=$"Device ID", reset=TRUE) -> (session handle out=w3, error out=w4)
  Property Node(instance in=w3, "Enabled Channels"=w1, error in=w4) -> (error out=w5, instance out=w6)
  call "niUSRP Configure Signal.gvi"(session handle=w6, IQ rate=$"IQ rate", carrier frequency=$"Carrier Frequency", gain=$Gain, error in=w5, active antenna=w2) -> (session handle out=w7, coerced IQ rate=w8, error out=w9)
  s1 = uninitialised  # shift register
  while {
    call "MT Generate Bits (Galois, PN Order).gvi"(error in=w9) -> (output bit stream=w10, error out=w11)
    call "MT RS Symbol Encoder (normal).gvi"(input symbols=w10, code word length (n), symbols=64, data word length (k), symbols=32, error in=w11, reset?=TRUE) -> (output symbols=w12, error out=w13)
    call "MT Convolutional Encoder (Rate).gvi"(input bit stream=w12, rate="1/2", error in=w13, reset?=TRUE) -> (output bit stream=w14, error out=w15)
    Divide(x=w8, y=16) -> w16
    call "MT Generate PAM System Parameters (M).gvi"(samples per symbol=16) -> (PAM system parameters=w17)
    call "MT Generate Filter Coefficients.gvi"(pulse shaping filter="none", modulation type="PAM") -> (pulse shaping filter coefficients=w18)
    call "MT Modulate PAM.gvi"(input bit stream=w14, PAM system parameters=w17, symbol rate=w16, pulse shaping filter coefficients=w18, error in=w15) -> (output complex waveform=w19, error out=w20)
    Property Node(instance in=w19) -> (instance out=w21)
    call "niUSRP Write Tx Data (CDB Cluster).gvi"(session handle=w7, data=w21, end of data?=$Stop, error in=w20, channel list=w1) -> (session handle out=w22, error out=w23)
    Logical Or(w23, $Stop) -> w24
    next s1 = w23
    stop if w24
  }
  call "niUSRP Close Session.gvi"(session handle=w22, error in=s1)
