vi "Function.gvi"   [LabVIEW Communications System Design Suite 2.0.1]
panel controls:
  "DataWordLength": i32
  "CodeWordLength": i32
  "symbol_rate": f64
  "DataWordLength_2": i32
  "CodeWordLength_2": i32
  "Sync Preamble": i8[]
panel indicators:
  "RS output": i32[]
  "Num_in": i32[]
  "Error Out": error
  "Numeric Array Output": i8[]
  "Numeric Array Input": i8[]
  "Num_out": i32[]
diagram:
  Math Node("Data_per_frame"=$DataWordLength) -> ("e"=w1, Error Out=w2)
  ~~~
  e=randint(Data_per_frame, 1, [0 15])
  ~~~
  To Long Integer(number=w1) -> w3
  $Num_in <- w3
  call "MT RS Symbol Encoder (normal).gvi"(input symbols=w3, code word length (n), symbols=$CodeWordLength, data word length (k), symbols=$DataWordLength, error in=w2) -> (output symbols=w4, error out=w5)
  $"RS output" <- w4
  Math Node("x"=w4, Error In=w5) -> ("y"=w6, Error Out=w7)
  ~~~
  y=zeros(size(x,2)*4,1)
  count=1
  for i=x
      y(count:count+3)=bitget(i,1:4)
      count=count+4
  end
  y=y'
  ~~~
  call "MT Convolutional Encoder (Rate).gvi"(input bit stream=w6, rate="1/4", constraint length=3, initial state=0, error in=w7, reset?=TRUE) -> (output bit stream=w8, error out=w9)
  Math Node("x"=w8, Error In=w9) -> ("y"=w10, Error Out=w11)
  ~~~
  y=[x, x]
  count=1
  for i = x
      if i==1
          y(count)=1
          y(count+1)=0
      else
          y(count)=0
          y(count+1)=1
      end
      count=count+2
  end
  ~~~
  Math Node("byte_stream"=w10, Error In=w11) -> ("frame_out_i8"=w12, Error Out=w13)
  ~~~
  start_of_frame=[1 1 1 1 0 1 1 1 1 0]
  end_of_frame=[0 0 0 0 1 0 0 0 0 1]
  frame_out=[start_of_frame byte_stream end_of_frame]
  frame_out_i8=frame_out
  ~~~
  $"Numeric Array Input" <- w12
  call "MT Generate PAM System Parameters (M).gvi"(samples per symbol=16) -> (PAM system parameters=w14)
  call "MT Generate Filter Coefficients.gvi"(pulse shaping filter="none", matched samples per symbol=16, modulation type="PAM") -> (pulse shaping filter coefficients=w15, matched filter coefficients=w16)
  call "MT Modulate PAM.gvi"(input bit stream=w12, PAM system parameters=w14, symbol rate=$symbol_rate, pulse shaping filter coefficients=w15, error in=w13) -> (output complex waveform=w17, error out=w18)
  call "MT Generate PAM Synchronization Parameters (bit array).gvi"(PAM system parameters=w14, sync bits=$"Sync Preamble", expected sync location=-1, sync location uncertainty=-1, sync indent=0) -> (PAM synchronization parameters=w19)
  call "MT Demodulate PAM.gvi"(input complex waveform=w17, PAM system parameters=w14, matched filter coefficients=w16, synchronization parameters=w19, error in=w18) -> (output bit stream=w20, error out=w21)
  Math Node("bits_in1"=w20, Error In=w21) -> ("bits_to_cc"=w22, Error Out=w23)
  ~~~
  y=zeros(1,240)
  bits_in=bits_in1(10:489)
  for count=1:240
      if bits_in(2*(count)-1:2*count)==[1 0]
          y(count)=1
      elseif bits_in(2*(count)-1:2*count)==[0 1]
          y(count)=0
      elseif bits_in(2*(count)-1:2*count)==[0 0]
          y(count)=0
      else
          y(count)=1
      end
  end
  bits_to_cc=[y zeros(1,60)]'
  ~~~
  call "MT Convolutional Decoder (Viterbi Hard Decision, Rate).gvi"(input bit stream=w22, rate="1/4", error in=w23, traceback depth=15) -> (output bit stream=w24, error out=w25)
  Math Node("x_in"=w24, Error In=w25) -> ("y_out"=w26, Error Out=w27)
  ~~~
  y_out=zeros(15,1)
  for i =1:15
      y_out(i)=1*x_in(i*4-3)+2*x_in(i*4-2)+4*x_in(i*4-1)+8*x_in(i*4)
  end
  ~~~
  call "MT RS Symbol Decoder (normal).gvi"(input symbols=w26, code word length (n), symbols=$CodeWordLength_2, data word length (k), symbols=$DataWordLength_2, error in=w27, modulation session=0, reset?=TRUE) -> (output symbols=w28, error out=w29)
  Reverse 1D Array(array=w28) -> (reversed array=w30)
  $Num_out <- w30
  $"Error Out" <- w29
  $"Numeric Array Output" <- w20
