vi "Reciever.gvi"   [LabVIEW Communications System Design Suite 2.0.1]
panel controls:
  "DataWordLength_2": i32
  "CodeWordLength_2": i32
panel indicators:
  "Num_out": i32[]
  "Numeric Array Output": f64[]
  "Error Out": error
diagram:
  w1 = path "C:\\Users\\LTE\\Documents\\LabVIEW Projects\\Transmitter_Team_1_BTECH16\\data_out.txt"
  Read From Text File(file (use dialog)=w1) -> (error out=w2, text=w3)
  Spreadsheet String To Array(array type=f64[][] [], delimiter=" ", format string="%d", spreadsheet string=w3) -> (array=w4)
  Reshape Array(inArray=w4, size=4500) -> w5
  Math Node("bits_in1"=w5, Error In=w2) -> ("bits_to_cc"=w6, Error Out=w7)
  ~~~
  y=zeros(1,240)
  bits_in=bits_in1(11:490)
  for count=1:240
      if bits_in(2*(count)-1:2*count)==[1 0]
          y(count)=1
      elseif bits_in(2*(count)-1:2*count)==[0 1]
          y(count)=0
      elseif bits_in(2*(count)-1:2*count)==[0 0]
          y(count)=0
      else
          y(count)=1
      end
  end
  bits_to_cc=[y zeros(1,60)]'
  ~~~
  call "MT Convolutional Decoder (Viterbi Hard Decision, Rate).gvi"(input bit stream=w6, rate="1/4", error in=w7, traceback depth=15) -> (output bit stream=w8, error out=w9)
  Math Node("x_in"=w8, Error In=w9) -> ("y_out"=w10, Error Out=w11)
  ~~~
  y_out=zeros(15,1)
  for i =1:15
      y_out(i)=1*x_in(i*4-3)+2*x_in(i*4-2)+4*x_in(i*4-1)+8*x_in(i*4)
  end
  ~~~
  call "MT RS Symbol Decoder (normal).gvi"(input symbols=w10, code word length (n), symbols=$CodeWordLength_2, data word length (k), symbols=$DataWordLength_2, error in=w11, modulation session=0, reset?=TRUE) -> (output symbols=w12, error out=w13)
  Reverse 1D Array(array=w12) -> (reversed array=w14)
  $Num_out <- w14
  Array To Spreadsheet String(array=w14, delimiter=" ", format string="%d") -> (spreadsheet string=w15)
  w16 = path "C:\\Users\\LTE\\Documents\\LabVIEW Projects\\Reciever_TEAM1_IDP2016\\Reciever_out.txt"
  Write To Text File(error in=w13, file (use dialog)=w16, text=w15) -> (error out=w17)
  $"Error Out" <- w17
  $"Numeric Array Output" <- w5
