vi "Transmitter.gvi"   [LabVIEW Communications System Design Suite 2.0.1]
panel controls:
  "DataWordLength": i32
  "CodeWordLength": i32
  "Iterations": f64
panel indicators:
  "RS output": i32[]
  "Num_in": i32[]
  "Numeric Array Input": i8[]
  "Error Out": error
diagram:
  w1 = $Iterations
  for (N = w1) {
    Math Node("Data_per_frame"=$DataWordLength) -> ("e"=w3, Error Out=w4)
    ~~~
    e=randint(Data_per_frame, 1, [0 15])
    ~~~
    To Long Integer(number=w3) -> w5
    $Num_in <- w5
    call "MT RS Symbol Encoder (normal).gvi"(input symbols=w5, code word length (n), symbols=$CodeWordLength, data word length (k), symbols=$DataWordLength, error in=w4) -> (output symbols=w6, error out=w7)
    $"RS output" <- w6
    Math Node("x"=w6, Error In=w7) -> ("y"=w8, Error Out=w9)
    ~~~
    y=zeros(size(x,2)*4,1)
    count=1
    for i=x
        y(count:count+3)=bitget(i,1:4)
        count=count+4
    end
    y=y'
    ~~~
    call "MT Convolutional Encoder (Rate).gvi"(input bit stream=w8, rate="1/4", constraint length=3, initial state=0, error in=w9, reset?=TRUE) -> (output bit stream=w10, error out=w11)
    Math Node("x"=w10, Error In=w11) -> ("y"=w12, Error Out=w13)
    ~~~
    y=[x, x]
    count=1
    for i = x
        if i==1
            y(count)=1
            y(count+1)=0
        else
            y(count)=0
            y(count+1)=1
        end
        count=count+2
    end
    ~~~
    Math Node("byte_stream"=w12, Error In=w13) -> ("frame_out_i8"=w14, Error Out=w15)
    ~~~
    start_of_frame=[1 1 1 1 0 1 1 1 1 0]
    end_of_frame=[0 0 0 0 1 0 0 0 0 1]
    frame_out=[start_of_frame byte_stream end_of_frame]
    frame_out_i8=frame_out
    ~~~
    $"Numeric Array Input" <- w14
    append w14 to w2
  }
  w16 = path "C:\\Users\\LTE\\Documents\\LabVIEW Projects\\Transmitter_Team_1_BTECH16\\data_out.txt"
  Array To Spreadsheet String(array=w2, delimiter=" ", format string="%d") -> (spreadsheet string=w17)
  Write To Text File(error in=w15, file (use dialog)=w16, text=w17) -> (error out=w18)
  $"Error Out" <- w18
